# Grasshopper definition excel00hops.gh (Grasshopper 1.0.7)
# plug-ins: LunchBox

boolean = GetBoolean(AtLeast=1, AtMost=1, FalseValue="False", Prompt="read/not read", TreeAccess=False, TrueValue="True")
excel = GetFilePath(AtLeast=1, AtMost=1, Prompt="path", TreeAccess=False)
worksheet = GetString(AtLeast=1, AtMost=1, Prompt="name of worksheet", TreeAccess=False)
excelread = ExcelReader(ReadExcelData=boolean, WorkbookPath=excel, WorksheetName=worksheet)  # -> Exceptions, ExcelData
null = NullItem(Item=boolean)  # -> NullFlags, InvalidFlags, Description
panel = Panel(excelread.ExcelData)
bang = ExplodeTree(Data=excelread.ExcelData)  # -> Branch0, graft(Branch1)
bang_2 = ExplodeTree(Data=simplify(bang.Branch1))  # -> Branch0, Branch1, Branch2
txt = Text("255,0,0")
filter = StreamFilter(Gate=boolean, Stream0="37", Stream1=bang_2.Branch0)
filter_2 = StreamFilter(Gate=boolean, Stream0=txt, Stream1=bang_2.Branch2)
filter_3 = StreamFilter(Gate=boolean, Stream0="6", Stream1=bang_2.Branch1)
p_n_c = PickNChoose(Pattern=null.NullFlags, Stream0=filter, Stream1="37")
p_n_c_2 = PickNChoose(Pattern=null.NullFlags, Stream0=filter_3, Stream1="6")
p_n_c_3 = PickNChoose(Pattern=null.NullFlags, Stream0=filter_2, Stream1=txt)
txt_2 = Text(p_n_c_3)
msphere = MeshSphere(Base=PlaneXY(0, 0, 0), Radius=p_n_c, UCount=p_n_c_2, VCount=p_n_c_2)
concat = Concatenate(FragmentA="(", FragmentB=txt_2, FragmentC=")")
mcol = MeshColours(Mesh=msphere, Colours=p_n_c_3)

# ---- group: RH_OUT:Mesh
mesh = Mesh(mcol)
