# Grasshopper definition isosrf_millipede.gh (Grasshopper 1.0.7)
# plug-ins: Millipede, Weaverbird

xy = XYPlane(Origin=Point(0, 0, 0))
panel = Panel("""1.0
-1.0""")
point = GetInteger(Slider(8, range=3..20), AtLeast=1, AtMost=1, Maximum=20, Minimum=3)
point_2 = GetInteger(Slider(1, range=0..5), AtLeast=1, AtMost=1, Maximum=5, Minimum=0, Prompt="Seed")
range = Range(Domain=Domain(0, 1), Steps=expr("x-1", "50"))
box = DomainBox(Base=xy, X="100", Y="100", Z="100")
pop3d = Populate3D(Region=box, Count=point, Seed=point_2)
crossref = CrossReference(ListA=range, ListB=range, ListC=range, CrossMode=1)  # -> ListA, ListB, ListC
repeat = RepeatData(Data=panel, Length=point)
pt = Point(pop3d)
box_2 = EvaluateBox(Box=box, UParameter=crossref.ListA, VParameter=crossref.ListB, WParameter=crossref.ListC)  # -> Plane, Point, Include
pcharge = PointCharge(Point=pt, Charge=repeat, Decay=2)
pt_2 = Point(box_2.Point)
pln = Plane(box_2.Plane)
mergef = MergeFields(Fields=pcharge)
evf = EvaluateField(Field=mergef, Point=pt_2)  # -> Tensor, Strength
avr = Average(Input=evf.Strength)
panel_2 = Panel(avr)
isovalue = GetNumber(Slider(0.000986, range=0..0.01), AtLeast=1, AtMost=1, Maximum=0.01, Minimum=0, Prompt="use value of 0.000000 digits")
iso_surface = IsoSurface(
    Box=box,
    Values=evf.Strength,
    XResolution="50",
    YResolution="50",
    ZResolution="50",
    IsoValue=isovalue,
    MergeVertices=Toggle(True))
wbvertices = WeaverbirdsVerticesComponent(MeshClosedPolylinesGroup=iso_surface, Weld=True)
bbox = BoundingBox(Content=iso_surface, Plane=PlaneXY(0, 0, 0))  # -> Box, Box_2
volume = Volume(Geometry=bbox.Box)  # -> Volume, Centroid
pt_3 = Point(volume.Centroid)
dist = Distance(PointA=pt_3, PointB=wbvertices)
bnd = Bounds(Numbers=dist)
remap = RemapNumbers(Value=dist, Source=bnd, Target="0 to 255")  # -> Mapped, Clipped
rgb = ColourRGB(Alpha=255, Red=remap.Mapped, Green=remap.Mapped, Blue=remap.Mapped)
mcol = MeshColours(Mesh=iso_surface, Colours=rgb)
wbthicken = WeaverbirdsMeshThicken(MeshCurves=mcol, Distance="2", OffsetType=0)

# ---- group: RH_OUT:M
mesh = Mesh(wbthicken)
